# Grasshopper definition Remap+Ranking_Internalised.gh (Grasshopper 1.0.7)
# plug-ins: Pufferfish

# Hexagon Curves
# Amenities
# Parks
curve = Curve([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])
# Public Transport
data = Data(Tree({1}: ["12", "12", "11", "8", "4", "3", "0", "0", "2", "9"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], {2}: ["2", "2", "2", "0", "0", "0", "0", "0", "0", "0"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], {3}: ["4", "4", "5", "11", "12", "12", "14", "14", "10", "7"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]))
data_2 = Data([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])
data_3 = Data(Tree({1}: ["0.301182", "0.342825", "0.284495", "0.181715", "0.146827", "0.05615"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], {2}: ["3405.991345", "3502.110836", "3814.623091", "4403.491978", "5186.850109", "5678.610205"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], {3}: ["3531.819902", "3717.218651", "4086.491918", "4472.188433", "5015.663582", "5691.043978"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], {4}: ["0.007689", "0.005114", "0.007488", "0.017117", "0.014787", "0.035047"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], {5}: ["0", "0", "0", "0", "0", "0"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], {6}: ["0.006931", "0.010971", "0.006773", "0.002435", "0.002337", "0.002865"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], {7}: ["7.811251", "7.944987", "0", "11.5579", "0", "0"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], {8}: ["0.02299", "0.034569", "0.023609", "0.010901", "0.010626", "0.004203"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]))
bounding_box = BoundingBox(Content=flatten(curve), Plane=PlaneXY(0, 0, 0), UnionBox=True)  # -> Box, Box_2
number_slider = Slider(0.09, range=0.01..0.1)
area = Area(Geometry=bounding_box.Box)  # -> Area, Centroid
panel = Panel(data_3)
panel_2 = Panel(data)
scale = Scale(Geometry=data_2, Center=area.Centroid, Factor=number_slider)  # -> Geometry, Transform
scale_2 = Scale(Geometry=curve, Center=area.Centroid, Factor=number_slider)  # -> Geometry, Transform
series = Series(Start="1", Step=1, Count="8")
orient = Orient(Geometry=scale.Geometry, Source=area.Centroid, Target=PlaneXY(0, 0, 0))  # -> Geometry, Transform
cull_index = CullIndex(List=series, Indices=expr("x-1", ["2", "3"]), Wrap=True)
tree_branch = TreeBranch(Tree=data_3, Path=["3", "2"], MaintainPaths=True)
orient_2 = Orient(Geometry=scale_2.Geometry, Source=area.Centroid, Target=PlaneXY(0, 0, 0))  # -> Geometry, Transform
tree_branch_2 = TreeBranch(Tree=data_3, Path=cull_index, MaintainPaths=True)
panel_3 = Panel(tree_branch_2)
bounds = Bounds(Numbers=tree_branch)
deconstruct_domain = DeconstructDomain(Domain=bounds)  # -> Start, End
replace_nulls = ReplaceNulls(Items=tree_branch_2, Replacements="0")  # -> Items, Count
construct_domain = ConstructDomain(DomainStart=deconstruct_domain.End, DomainEnd=deconstruct_domain.Start)
bounds_2 = Bounds(Numbers=replace_nulls.Items)
remap_numbers = RemapNumbers(Value=tree_branch, Source=construct_domain, Target=Domain(0, 1))  # -> Mapped, Clipped
remap_numbers_2 = RemapNumbers(Value=tree_branch_2, Source=bounds_2, Target=Domain(0, 1))  # -> Mapped, Clipped
panel_4 = Panel(bounds_2)
panel_5 = Panel(remap_numbers_2.Mapped)
flip_matrix = FlipMatrix(Data=remap_numbers.Mapped)
flip_matrix_2 = FlipMatrix(Data=remap_numbers_2.Mapped)
merge = Merge(Data1=flip_matrix, Data2=flip_matrix_2)
mass_addition = MassAddition(Input=merge)  # -> flatten(Result), PartialResults
bounds_3 = Bounds(Numbers=mass_addition.Result)
quick_graph = QuickGraph(mass_addition.Result, SortOrder=0)
remap_numbers_3 = RemapNumbers(Value=mass_addition.Result, Source=bounds_3, Target=Domain(0, 1))  # -> Mapped, Clipped
# Preview the classification
graph_mapper = GraphMapper(remap_numbers_3.Mapped, x0=0, x1=1, y0=0, y1=1, container_name="Bezier", cpx=[0, 0.8399885893, 0, 1], cpy=[0, 0, 1, 1])
gradient = Gradient(LowerLimit=0, UpperLimit=1, Parameter=graph_mapper, stops=[0: RGB(0, 128, 0), 0.5: RGB(255, 255, 0), 1: RGB(255, 0, 0)])
curve_2 = Curve(orient_2.Geometry)
surface = Surface(curve_2)

# ----
# The least score hexagons
number_slider_2 = Slider(0.3, range=0..1)
smaller_than = SmallerThan(FirstNumber=graph_mapper, SecondNumber=number_slider_2)  # -> SmallerThan, OrEqualTo
dispatch = Dispatch(List=surface, DispatchPattern=smaller_than.SmallerThan)  # -> ListA, ListB
surface_2 = Surface(dispatch.ListA)
xy_plane = XYPlane(Origin=Point(0, 0, 0))
area_2 = Area(Geometry=curve_2)  # -> Area, Centroid
area_3 = Area(Geometry=surface_2)  # -> Area, Centroid
region_union = RegionUnion(Curves=orient.Geometry, Plane=xy_plane)
point_in_curve = PointInCurve(Point=area_3.Centroid, Curve=region_union)  # -> Relationship, Point
dispatch_2 = Dispatch(List=surface_2, DispatchPattern=point_in_curve.Relationship)  # -> ListA, ListB
surface_3 = Surface(dispatch_2.ListA)
area_4 = Area(Geometry=surface_3)  # -> Area, Centroid
closest_point = ClosestPoint(Point=area_4.Centroid, Cloud=area_2.Centroid)  # -> ClosestPoint, CPIndex, Distance
tree_branch_3 = TreeBranch(Tree=merge, Path=closest_point.CPIndex, MaintainPaths=True)

area_5 = Area(Geometry=surface)  # -> Area, Centroid
rangevalue = Slider(1000, range=0..1000)
rangevalue1 = Slider(2037, range=2000..2050)
rangevalue2 = Slider(2, range=0..5)
# Amenities per capita
panel_6 = Panel("2020")
# Year of Prediction
rangevalue_2 = GetNumber(rangevalue, AtLeast=1, AtMost=2147483647, Maximum=1.797693135e+308, Minimum=-1.797693135e+308)
rangevalue1_2 = GetNumber(rangevalue1, AtLeast=1, AtMost=2147483647, Maximum=1.797693135e+308, Minimum=-1.797693135e+308)
number = Number(expr("X-1999", panel_6))
number_2 = Number(expr("X-1999", rangevalue1_2))
rangevalue2_2 = GetNumber(rangevalue2, AtLeast=1, AtMost=2147483647, Maximum=1.797693135e+308, Minimum=-1.797693135e+308)
number_3 = Number(Tree({1}: [13.608772, 25.026316, 0.272544, 9.101754, 548323.0877, 6.52193, 2.601754, 2403.192982, 39.247368, 452.57193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], {2}: [13.441579, 26.713158, 0.2706, 9.236316, 545987.6105, 6.486842, 2.466316, 2411.415789, 37.614737, 454.726842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], {3}: [13.274386, 28.4, 0.268656, 9.370877, 543652.1333, 6.451754, 2.330877, 2419.638596, 35.982105, 456.881754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], {4}: [13.107193, 30.086842, 0.266712, 9.505439, 541316.6561, 6.416667, 2.195439, 2427.861404, 34.349474, 459.036667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], {5}: [12.94, 31.773684, 0.264768, 9.64, 538981.1789, 6.381579, 2.06, 2436.084211, 32.716842, 461.191579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], {6}: [12.772807, 33.460526, 0.262825, 9.774561, 536645.7018, 6.346491, 1.924561, 2444.307018, 31.084211, 463.346491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]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))
# Metric Number
division = Division(A=rangevalue_2, B=Slider(10, range=0..100))
tree_branch_4 = TreeBranch(Tree=number_3, Path=number, MaintainPaths=True)
tree_branch_5 = TreeBranch(Tree=number_3, Path=number_2, MaintainPaths=True)

panel_7 = Panel(tree_branch_4)
panel_8 = Panel(tree_branch_5)

# ----
# Keshava's Metrics
# Pedro's Metrics
# ML Prediction
# Mass to void ratio in hexagon
# Closest distance to healthcare
# Closest distance to Parks
# number of education facilities per capita
# Area of Green Space per capita
# Area of commercial to residential in a hexagon
# Population density in hexagon
panel_9 = Panel("""Hospital_beds_per_1000
Green_Energy_produced
Investment_Heath_GDP
Newborns
Population
Poverty_rate
Price_Index
Road_Accidents_yr
School_leavers_rate
Transportation_metro
Solid_waste_collection""")
split_list = SplitList(List=panel_7, Index="11")  # -> ListA, ListB
split_list_2 = SplitList(List=panel_8, Index="11")  # -> ListA, ListB
panel_10 = Panel(split_list.ListA)
panel_11 = Panel(split_list_2.ListA)

# ----
# 0. Change in Green Space for each hexagon
# 1. Change in Ratio of Amenities per hexagon
# 2. Change in Public Transport per hexagon
point = Point(Point(78.14222577, 21.9514615, 0))
surface_4 = Surface(curve_2)
point_2 = GetPoint(point, AtLeast=1, AtMost=2147483647, Realtime=True)
area_6 = Area(Geometry=surface_4)  # -> Area, Centroid
circle = Circle(Plane=point_2, Radius=division)
# Select this to move the point
# across the city map
panel_12 = Panel(point)
closest_point_2 = ClosestPoint(Point=point_2, Cloud=area_6.Centroid)  # -> ClosestPoint, CPIndex, Distance
list_item = ListItem(List=curve_2, Index=closest_point_2.CPIndex, Wrap=True)
# Pedro's Metric
pedro_s_metric = Slider(10, range=0..10)
# Pedro's Metric
pedro_s_metric_2 = Slider(8, range=0..10)

# ---- group: RH_OUT:hex
# Selected Hexagon
crv = Curve(list_item)

# ----
# Pedro's Metric
pedro_s_metric_3 = Slider(1, range=0..10)
pedro_s_metric_4 = Slider(6, range=0..10)
# Keshava's Metric
number_slider_3 = Slider(3, range=0..10)
# Pedro's Metric
pedro_s_metric_5 = Slider(9, range=0..10)
# Pedro's Metric
pedro_s_metric_6 = Slider(3, range=0..10)
tree_branch_6 = TreeBranch(Tree=data_3, Path="8", MaintainPaths=False)
list_item_2 = ListItem(List=split_list_2.ListA, Index=pedro_s_metric_2, Wrap=True)
list_item_3 = ListItem(List=merge, Index=Slider(4, range=0..10), Wrap=True)
list_item_4 = ListItem(List=panel_10, Index=pedro_s_metric_2, Wrap=True)
list_item_5 = ListItem(List=split_list_2.ListA, Index=pedro_s_metric, Wrap=True)
number_4 = Number(101826.6346)
list_item_6 = ListItem(List=panel_10, Index=pedro_s_metric, Wrap=True)
multiplication = Multiplication(A=tree_branch_6, B=number_4)
division_2 = Division(A=list_item_2, B=list_item_4)
panel_13 = Panel(list_item_5)
list_item_7 = ListItem(List=panel_10, Index=pedro_s_metric_4, Wrap=True)
list_item_8 = ListItem(List=split_list_2.ListA, Index=pedro_s_metric_4, Wrap=True)
list_item_9 = ListItem(List=merge, Index=number_slider_3, Wrap=True)
flip_matrix_3 = FlipMatrix(Data=data)
list_item_10 = ListItem(List=panel_10, Index=pedro_s_metric_5, Wrap=True)
list_item_11 = ListItem(List=split_list_2.ListA, Index=pedro_s_metric_5, Wrap=True)
round = Round(Number=multiplication)  # -> Nearest, Floor, Ceiling
division_3 = Division(A=list_item_5, B=list_item_6)
list_item_12 = ListItem(List=split_list_2.ListA, Index=pedro_s_metric_3, Wrap=True)
list_item_13 = ListItem(List=merge, Index=Slider(5, range=0..10), Wrap=True)
list_item_14 = ListItem(List=panel_10, Index=pedro_s_metric_3, Wrap=True)
panel_14 = Panel(list_item_9)
division_4 = Division(A=list_item_11, B=list_item_10)
division_5 = Division(A=list_item_8, B=list_item_7)
list_item_15 = ListItem(List=split_list_2.ListA, Index=pedro_s_metric_6, Wrap=True)
list_item_16 = ListItem(List=panel_10, Index=pedro_s_metric_6, Wrap=True)
list_item_17 = ListItem(List=flip_matrix_3, Index=Slider(2, range=0..2), Wrap=True)
multiplication_2 = Multiplication(A=division_2, B=list_item_3)
number_5 = Number(simplify(graft(round.Nearest)))
division_6 = Division(A=list_item_12, B=list_item_14)
division_7 = Division(A=list_item_15, B=list_item_16)
multiplication_3 = Multiplication(A=division_5, B=panel_14)
tree_branch_7 = TreeBranch(Tree=list_item_17, Path=closest_point.CPIndex, MaintainPaths=True)
# Population per hexagon
panel_15 = Panel(round.Nearest)
bounds_4 = Bounds(Numbers=panel_15)
multiplication_4 = Multiplication(A=division_6, B=list_item_13)
multiplication_5 = Multiplication(A=division_7, B="23")
multiplication_6 = Multiplication(A=division_4, B=tree_branch_7)
bounds_5 = Bounds(Numbers=flatten(panel_15))
remap_numbers_4 = RemapNumbers(Value=panel_15, Source=bounds_4, Target=Domain(0, 1))  # -> Mapped, Clipped
# Predicted Increase in Educational Facilities pre Capita
panel_16 = Panel(multiplication_2)
subtraction = Subtraction(A=multiplication_5, B="23")
# Predicted Increase in Green Space pre Capita
panel_17 = Panel(multiplication_4)
remap_numbers_5 = RemapNumbers(Value=flatten(panel_15), Source=bounds_5, Target=Domain(0, 1))  # -> Mapped, Clipped
# Predicted Ratio of Amenities per Capita
panel_18 = Panel(multiplication_3)
# Pred number of Public Transport
panel_19 = Panel(multiplication_6)
multiplication_7 = Multiplication(A=division_3, B=remap_numbers_4.Mapped)
number_slider_4 = Slider(1000, range=0..1000)
mass_addition_2 = MassAddition(Input=multiplication_7)  # -> Result, PartialResults
graph_mapper_2 = GraphMapper(remap_numbers_5.Mapped, x0=0, x1=1, y0=0, y1=1, container_name="Sigmoid-Logits", e=0.2467943281, t0=-100, t1=100)
# Change in Requirement of Hospitals
panel_20 = Panel(subtraction)
subtraction_2 = Subtraction(A=panel_16, B=list_item_3)
multiplication_8 = Multiplication(A=mass_addition_2.Result, B=number_slider_4)
# Change in Green Space per Capita
subtraction_3 = Subtraction(A=panel_17, B=list_item_13)
subtraction_4 = Subtraction(A=panel_19, B=list_item_17)
data_4 = Data(graph_mapper_2)
# Change in Ratio of Amenities per Capita
subtraction_5 = Subtraction(A=panel_18, B=panel_14)
panel_21 = Panel(subtraction_2)
panel_22 = Panel(subtraction_3)
panel_23 = Panel(multiplication_8)
panel_24 = Panel(subtraction_5)
gradient_2 = Gradient(
    LowerLimit=0,
    UpperLimit=1,
    Parameter=graph_mapper_2,
    stops=[0: RGB(0, 128, 0), 0.29: RGB(255, 255, 0), 0.624: RGB(255, 0, 0)])
multiplication_9 = Multiplication(A=multiplication_7, B=number_slider_4)  # -> simplify(graft(Result))
multiplication_10 = Multiplication(A=simplify(graft(round.Nearest)), B=panel_24)
multiplication_11 = Multiplication(A=simplify(graft(round.Nearest)), B=panel_21)  # -> simplify(Result)
multiplication_12 = Multiplication(A=simplify(graft(round.Nearest)), B=panel_22)
# Solid Waste Generation
panel_25 = Panel(multiplication_9)
# Change in Ratio of Amenities per hexagon
panel_26 = Panel(multiplication_10)
# Change in Public Transport
panel_27 = Panel(subtraction_4)
# Change in Green Space for each hexagon
panel_28 = Panel(multiplication_12)
# Predicted Increase in Educational Facilities for each hexagon
panel_29 = Panel(multiplication_11)
bounds_6 = Bounds(Numbers=flatten(panel_25))
bounds_7 = Bounds(Numbers=flatten(panel_28))
round_to_decimal_place = RoundToDecimalPlace(NumberX=panel_26, DecimalPlace="2", RoundType=0)  # -> Rounded, Difference
bounds_8 = Bounds(Numbers=flatten(panel_27))
bounds_9 = Bounds(Numbers=flatten(panel_29))
data_5 = Data(gradient_2)
remap_numbers_6 = RemapNumbers(Value=flatten(panel_27), Source=bounds_8, Target=Domain(0, 1))  # -> Mapped, Clipped
remap_numbers_7 = RemapNumbers(Value=flatten(panel_25), Source=bounds_6, Target=Domain(0, 1))  # -> Mapped, Clipped
remap_numbers_8 = RemapNumbers(Value=flatten(panel_28), Source=bounds_7, Target=Domain(0, 1))  # -> Mapped, Clipped
bounds_10 = Bounds(Numbers=flatten(round_to_decimal_place.Rounded))
remap_numbers_9 = RemapNumbers(Value=flatten(panel_29), Source=bounds_9, Target=Domain(0, 1))  # -> Mapped, Clipped
data_6 = Data(Tree({0}: ["Santo António"], {1}: ["Parque das Nações"], {2}: ["Marvila"], {3}: ["Ajuda"], {4}: ["Areeiro"], {5}: ["Santa Maria Maior"]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))

# ----
# Pedro's metrics
number_6 = Number(split_list_2.ListB)
number_7 = Number(split_list.ListB)
panel_30 = Panel(number_6)
panel_31 = Panel(number_7)
bounds_11 = Bounds(Numbers=panel_30)
bounds_12 = Bounds(Numbers=panel_31)
construct_domain_2 = ConstructDomain(DomainStart=0, DomainEnd="14")
construct_domain_3 = ConstructDomain(DomainStart=0, DomainEnd="14")
remap_numbers_10 = RemapNumbers(Value=panel_30, Source=bounds_11, Target=construct_domain_2)  # -> Mapped, Clipped
remap_numbers_11 = RemapNumbers(Value=panel_31, Source=bounds_12, Target=construct_domain_3)  # -> Mapped, Clipped
sort_text = SortText(Keys=flatten(data_6), Values=flatten(orient.Geometry), Culture=127)  # -> Keys, Values
panel_32 = Panel(remap_numbers_11.Mapped)
panel_33 = Panel(remap_numbers_10.Mapped)
surface_5 = Surface(sort_text.Values)
area_7 = Area(Geometry=surface_5)  # -> Area, Centroid
mass_addition_3 = MassAddition(Input=panel_32)  # -> Result, PartialResults
closest_point_3 = ClosestPoint(Point=point, Cloud=area_7.Centroid)  # -> ClosestPoint, CPIndex, Distance
gradient_3 = Gradient(LowerLimit=0, UpperLimit="14", Parameter=panel_33, stops=[0: RGB(0, 128, 0), 0.5: RGB(255, 255, 0), 1: RGB(255, 0, 0)])
mass_addition_4 = MassAddition(Input=panel_33)  # -> Result, PartialResults
panel_34 = Panel(mass_addition_3.Result)
list_item_18 = ListItem(List=sort_text.Keys, Index=closest_point_3.CPIndex, Wrap=True)  # -> flatten(Item)
panel_35 = Panel(mass_addition_4.Result)
panel_36 = Panel(list_item_18)

graph_mapper_3 = GraphMapper(remap_numbers_6.Mapped, x0=0, x1=1, y0=0, y1=1, container_name="Sigmoid-Logits", e=0.7139804363, t0=-100, t1=100)
data_7 = Data(graph_mapper_3)
graph_mapper_4 = GraphMapper(remap_numbers_7.Mapped, x0=0, x1=1, y0=0, y1=1, container_name="Sigmoid-Logits", e=0.2467943281, t0=-100, t1=100)
data_8 = Data(graph_mapper_4)
graph_mapper_5 = GraphMapper(remap_numbers_8.Mapped, x0=0, x1=1, y0=0, y1=1, container_name="Sigmoid-Logits", e=0.2467943281, t0=-100, t1=100)
data_9 = Data(graph_mapper_5)
graph_mapper_6 = GraphMapper(remap_numbers_9.Mapped, x0=0, x1=1, y0=0, y1=1, container_name="Sigmoid-Logits", e=0.2467943281, t0=-100, t1=100)
data_10 = Data(graph_mapper_6)
# METRIC4
# Predicted Increase / Decrease in Solid Waste Generation
# METRIC5
# Population density per hexagon
gradient_4 = Gradient(
    LowerLimit=0,
    UpperLimit=1,
    Parameter=graph_mapper_4,
    stops=[0.138: RGB(255, 255, 255), 0.307: RGB(255, 255, 255), 0.542: RGB(79, 55, 25)])
data_11 = Data(gradient_4)
remap_numbers_12 = RemapNumbers(Value=flatten(round_to_decimal_place.Rounded), Source=bounds_10, Target=Domain(0, 1))  # -> Mapped, Clipped
# METRIC 3
# Predicted Increase in Educational Facilities for each hexagon
gradient_5 = Gradient(LowerLimit=0, UpperLimit=1, Parameter=graph_mapper_6, stops=[0.15: RGB(255, 255, 255), 0.85: RGB(208, 0, 255)])
data_12 = Data(gradient_5)
# Change in Public Transport per hexagon
gradient_6 = Gradient(
    LowerLimit=0,
    UpperLimit=1,
    Parameter=flatten(graph_mapper_3),
    stops=[0: RGB(0, 128, 0), 0.5: RGB(255, 255, 0), 1: RGB(255, 0, 0)])
data_13 = Data(gradient_6)
# METRIC0
# Change in Green Space for each hexagon
gradient_7 = Gradient(
    LowerLimit=0,
    UpperLimit=1,
    Parameter=flatten(graph_mapper_5),
    stops=[0: RGB(0, 98, 0), 0.25: RGB(175, 255, 122), 0.5: RGB(255, 255, 255), 0.75: RGB(235, 235, 235), 1: RGB(255, 255, 255)])
data_14 = Data(gradient_7)
line_sdl = LineSDL(Start=area_7.Centroid, Direction=Vector(0, 0, 1), Length=Slider(38, range=0..1000))
data_15 = Data(panel_25)
data_16 = Data(number_5)
data_17 = Data(panel_28)
data_18 = Data(round_to_decimal_place.Rounded)
data_19 = Data(panel_27)
data_20 = Data(panel_29)
graph_mapper_7 = GraphMapper(remap_numbers_12.Mapped, x0=0, x1=1, y0=0, y1=1, container_name="Bezier", cpx=[0, 0.25, 0.75, 1], cpy=[0, 0.25, 0.75, 1])
data_21 = Data(graph_mapper_7)
stream_filter = StreamFilter(Gate=rangevalue2_2, Stream0=data_9, Stream1=data_21, Stream2=data_7, Stream3=data_10, Stream4=data_8, Stream5=data_4)
multiplication_13 = Multiplication(A=stream_filter, B=Slider(152, range=0..1000))
stream_filter_2 = StreamFilter(Gate=rangevalue2_2, Stream0=data_17, Stream1=data_18, Stream2=data_19, Stream3=data_20, Stream4=data_15, Stream5=data_16)
end_points = EndPoints(Curve=line_sdl)  # -> Start, End
# METRIC1
# Change in Ratio of Amenities per hexagon
# METRIC2
gradient_8 = Gradient(LowerLimit=0, UpperLimit=1, Parameter=flatten(graph_mapper_7), stops=[0.15: RGB(255, 255, 255), 0.85: RGB(220, 0, 40)])
data_22 = Data(gradient_8)
stream_filter_3 = StreamFilter(Gate=rangevalue2_2, Stream0=data_14, Stream1=data_22, Stream2=data_13, Stream3=data_12, Stream4=data_11, Stream5=data_5)
xz_plane = XZPlane(Origin=end_points.End)
flip_plane = FlipPlane(Plane=xz_plane, ReverseX=invert(False), ReverseY=invert(False), SwapAxes=invert(True))
# METRIC
# Predicted Budget allotment for each district
mesh_colours = MeshColours(Mesh=graft(surface_5), Colours=graft(gradient_3))
# Plan or Bar graph?
boolean_toggle = BooleanToggle(True)

# ---- group: RH_IN:Plan
boolean = Boolean(True)

# ----
# Representation
boolean_toggle_2 = BooleanToggle(False)

# ---- group: RH_IN:Circle
boolean_2 = Boolean(False)

# ----
boolean_toggle_3 = BooleanToggle(False)  # disabled
stream_filter_4 = StreamFilter(Gate=boolean_toggle_3, Stream1=mesh_colours)  # disabled

# ---- group: RH_OUT:dist
crv_2 = Curve(simplify(flatten(orient.Geometry)))

# ---- group: RH_OUT:BudgetMesh
mesh = Mesh(simplify(stream_filter_4))  # disabled

# ----
surface_6 = Surface(curve_2)
construct_domain_4 = ConstructDomain(DomainStart=0, DomainEnd=Slider(10, range=0..100))
area_8 = Area(Geometry=surface_6)  # -> Area, Centroid
line_sdl_2 = LineSDL(Start=area_8.Centroid, Direction=Vector(0, 0, 1), Length=multiplication_13)
end_points_2 = EndPoints(Curve=line_sdl_2)  # -> Start, graft(End)
rectangle = Rectangle(Plane=area_8.Centroid, XSize=construct_domain_4, YSize=construct_domain_4, Radius=0)  # -> Rectangle, Length
closest_point_4 = ClosestPoint(Point=point, Cloud=area_8.Centroid)  # -> ClosestPoint, CPIndex, Distance
xz_plane_2 = XZPlane(Origin=end_points_2.End)
unit_z = UnitZ(Factor=multiplication_13)
surface_7 = Surface(rectangle.Rectangle)
extrude = Extrude(Base=surface_7, Direction=unit_z)
tree_branch_8 = TreeBranch(Tree=simplify(stream_filter_2), Path=closest_point_4.CPIndex, MaintainPaths=True)
tree_branch_9 = TreeBranch(Tree=simplify(xz_plane_2), Path=closest_point_4.CPIndex, MaintainPaths=True)
xy_plane_2 = XYPlane(Origin=Point(0, 0, 0))
data_23 = Data(flatten(stream_filter_2))
data_24 = Data(flatten(xz_plane_2))
region_union_2 = RegionUnion(Curves=orient.Geometry, Plane=xy_plane_2)
cull_index_2 = CullIndex(List=data_23, Indices=closest_point_4.CPIndex, Wrap=True)
cull_index_3 = CullIndex(List=data_24, Indices=closest_point_4.CPIndex, Wrap=True)
stream_filter_5 = StreamFilter(Gate=boolean, Stream1=extrude)
boolean_toggle_4 = BooleanToggle(True)
stream_filter_6 = StreamFilter(Gate=boolean, Stream0=surface_6, Stream1=stream_filter_5)
text = Text("Arial")
bool = Boolean(False)
area_9 = Area(Geometry=stream_filter_6)  # -> Area, Centroid

stream_filter_7 = StreamFilter(Gate=boolean_2, Stream0=circle, Stream1=region_union_2)
point_in_curve_2 = PointInCurve(Point=area_5.Centroid, Curve=stream_filter_7)  # -> Relationship, Point
panel_37 = Panel(point_in_curve_2.Relationship)
member_index = MemberIndex(Set=panel_37, Member="2")  # -> Index, Count
list_item_19 = ListItem(List=surface, Index=member_index.Index, Wrap=True)
list_item_20 = ListItem(List=gradient, Index=member_index.Index, Wrap=True)
mesh_colours_2 = MeshColours(Mesh=graft(list_item_19), Colours=graft(list_item_20))
c_script = CSharpScript(
    face=text,
    bold=bool,
    italics=boolean_toggle_4,
    size=Slider(10, range=0..100),
    content=flatten(sort_text.Keys),
    pl=flatten(flip_plane))  # -> out, simplify(A); inputs face: String, bold: Boolean, italics: Boolean, size: Double, content: String, pl: Plane
# ---------- c_script: C# usings ----------
using System.IO;
using System.Linq;
using System.Data;
using System.Drawing;
using System.Reflection;
using System.Windows.Forms;
using System.Xml;
using System.Xml.Linq;
using System.Runtime.InteropServices;

using Rhino.DocObjects;
using Rhino.Collections;
using GH_IO;
using GH_IO.Serialization;
# ---------- c_script: C# ----------
    if(size == 0)
      size = 1;

    if(!string.IsNullOrEmpty(face) && size > 0 && !string.IsNullOrEmpty(content) &&
      pl.IsValid)
    {
      using (var doc = Rhino.RhinoDoc.CreateHeadless(null))
      {
        var te = doc.Objects.AddText(content, pl, size, face, bold, italics);
        var txt = doc.Objects.Find(te) as Rhino.DocObjects.TextObject;

        if(txt != null)
        {
          var tt = txt.Geometry as Rhino.Geometry.TextEntity;
          A = tt.Explode();
        }
      }
    }
# ---------- end c_script ----------
list_item_21 = ListItem(List=region_union_2, Index=0, Wrap=True)
stream_filter_8 = StreamFilter(Gate=boolean_2, Stream0=circle, Stream1=list_item_21)
flip_plane_2 = FlipPlane(Plane=tree_branch_9, ReverseX=invert(False), ReverseY=invert(False), SwapAxes=invert(True))
mesh_2 = Mesh(mesh_colours_2)
stream_filter_9 = StreamFilter(Gate=boolean, Stream1=mesh_2)

# ---- group: RH_OUT:crvs
crv_3 = Curve(simplify(flatten(c_script.A)))

# ---- group: RH_OUT:ClassMesh
mesh_3 = Mesh(simplify(flatten(stream_filter_9)))

# ----
point_in_curve_3 = PointInCurve(Point=area_9.Centroid, Curve=stream_filter_8)  # -> Relationship, Point
c_script_2 = CSharpScript(
    face=text,
    bold=bool,
    italics=boolean_toggle_4,
    size=Slider(26, range=0..100),
    content=flatten(tree_branch_8),
    pl=flatten(flip_plane_2))  # -> out, simplify(A); inputs face: String, bold: Boolean, italics: Boolean, size: Double, content: String, pl: Plane; same code as c_script
panel_38 = Panel(point_in_curve_3.Relationship)
member_index_2 = MemberIndex(Set=panel_38, Member="2")  # -> Index, Count
list_item_22 = ListItem(List=stream_filter_6, Index=member_index_2.Index, Wrap=True)
list_item_23 = ListItem(List=stream_filter_3, Index=member_index_2.Index, Wrap=True)
mesh_colours_3 = MeshColours(Mesh=graft(list_item_22), Colours=graft(list_item_23))

list_item_24 = ListItem(List=cull_index_3, Index=member_index_2.Index, Wrap=True)
list_item_25 = ListItem(List=cull_index_2, Index=member_index_2.Index, Wrap=True)
flip_plane_3 = FlipPlane(Plane=list_item_24, ReverseX=invert(False), ReverseY=invert(False), SwapAxes=invert(True))

c_script_3 = CSharpScript(
    face=text,
    bold=bool,
    italics=boolean_toggle_4,
    size=Slider(5, range=0..100),
    content=flatten(list_item_25),
    pl=flatten(flip_plane_3))  # -> out, simplify(A); inputs face: String, bold: Boolean, italics: Boolean, size: Double, content: String, pl: Plane; same code as c_script
merge_2 = Merge(Data1=c_script_3.A, Data2=simplify(c_script_2.A))
stream_filter_10 = StreamFilter(Gate=boolean, Stream1=merge_2)

# ---- group: RH_OUT:ColMesh
mesh_4 = Mesh(simplify(flatten(mesh_colours_3)))

# ---- group: RH_OUT:crvsm
crv_4 = Curve(simplify(flatten(stream_filter_10)))
